# Requirement set HLR (R2023a)

## 1 [#1] Features (Container)
The libs shall include two functions: Sum and Diff.

### 1.1 [#3] Sum
The Sum function shall sum up two inputs

### 1.2 [#4] Diff
The Diff function shall return the difference between the _first_ and the second inputs.

### 1.3 [#2] Error handling (Container)

#### 1.3.1 [#5] Invalid inputs
If the inputs are not number, error out.