# Requirement set LLR (R2023a)

## 1 [#6] SumDiff lib (Informational)
SumDiff lib is a matlab package.

## 2 [#3] Two functions
The lib shall contain two functions (Sum and Diff).

## 3 [#1] Sum function
The sum function shall sum up two inputs.

## 4 [#2] Diff function
The Diff function shall return the difference between the _first_ input and the second input.

## 5 [#4] Sum error
The Sum function shall generate an error "Invalid input" if any of the input is not a number.

## 6 [#5] Diff error
The Diff function shall generate an error "Invalid inputs" if any of the input is not a number.

## 7 [#7] Sum range

## 8 [#8] Diff range

## 9 [#9] Performance